# Grasshopper definition flashlight_model2.gh (Grasshopper 1.0.7)

# ----
# Create handle bottom geometry
number_slider = Slider(18.3, range=0..60)
ellipse = Ellipse(Plane=PlaneXY(0, 0, 0), Radius1=number_slider, Radius2=Slider(18.2, range=0..40))  # -> Ellipse, Focus1, Focus2
vector_xyz = VectorXYZ(XComponent=0, YComponent=0, ZComponent=Slider(-142.28, range=-150..0))  # -> Vector, Length
move = Move(Geometry=ellipse.Ellipse, Motion=vector_xyz.Vector)  # -> Geometry, Transform

# ----
# Light top geometry
number_slider_2 = Slider(17.515, range=0..40)
number_slider_3 = Slider(25.31, range=0..60)
# Light Interior Geometry
number_slider_4 = Slider(14.43, range=0..40)
number_slider_5 = Slider(22.15, range=0..60)
ellipse_2 = Ellipse(Plane=PlaneXY(0, 0, 0), Radius1=number_slider_3, Radius2=number_slider_2)  # -> Ellipse, Focus1, Focus2
ellipse_3 = Ellipse(Plane=PlaneXY(0, 0, 0), Radius1=number_slider_5, Radius2=number_slider_4)  # -> Ellipse, Focus1, Focus2
number = Number(0.5)
cardboard_thickness = Slider(3.6, range=-10..10)
multiplication = Multiplication(A=number, B=cardboard_thickness)
vector_xyz_2 = VectorXYZ(XComponent=0, YComponent=0, ZComponent=Slider(-1.59, range=-10..10))  # -> Vector, Length
slot_depth = Slider(23.51, range=0..25.4)
subtraction = Subtraction(A=number_slider_4, B=multiplication)
addition = Addition(A=multiplication, B=number_slider_2)
move_2 = Move(Geometry=ellipse_3.Ellipse, Motion=vector_xyz_2.Vector)  # -> Geometry, Transform
subtraction_2 = Subtraction(A=number_slider_5, B=multiplication)
addition_2 = Addition(A=multiplication, B=number_slider_3)
number_2 = Number(-0.5)
rectangle = Rectangle(Plane=PlaneXY(0, 0, 0), XSize=slot_depth, YSize=cardboard_thickness, Radius=0)  # -> Rectangle, Length
ellipse_4 = Ellipse(Plane=PlaneXY(0, 0, 0), Radius1=addition_2, Radius2=addition)  # -> Ellipse, Focus1, Focus2
vector_xyz_3 = VectorXYZ(XComponent=0, YComponent=0, ZComponent=Slider(1.59, range=-10..10))  # -> Vector, Length
merge = Merge(Data1=ellipse_2.Ellipse, Data2=move.Geometry)
multiplication_2 = Multiplication(A=cardboard_thickness, B=number_2)
ellipse_5 = Ellipse(Plane=PlaneXY(0, 0, 0), Radius1=subtraction_2, Radius2=subtraction)  # -> Ellipse, Focus1, Focus2
extrude = Extrude(Base=move_2.Geometry, Direction=vector_xyz_3.Vector)
loft = Loft(Curves=merge, Options={Adjust=False, Closed=False, LoftEnds=0, LoftSimp=0, LoftType=0, Rebuild=10, Refit=0.01})
vector_xyz_4 = VectorXYZ(XComponent=slot_depth, YComponent=multiplication_2, ZComponent=0)  # -> Vector, Length
vector_xyz_5 = VectorXYZ(XComponent=0, YComponent=0, ZComponent=cardboard_thickness)  # -> Vector, Length
cap_holes = CapHoles(Brep=loft)
move_3 = Move(Geometry=rectangle.Rectangle, Motion=vector_xyz_4.Vector)  # -> Geometry, Transform
cap_holes_2 = CapHoles(Brep=extrude)
solid_difference = SolidDifference(BrepsA=cap_holes, BrepsB=cap_holes_2)
curve_array = CurveArray(Geometry=move_3.Geometry, Curve=ellipse_2.Ellipse, Count=Slider(12, range=0..12))  # -> Geometry, Transform
region_difference = RegionDifference(CurvesA=ellipse_4.Ellipse, CurvesB=curve_array.Geometry)
fillet = Fillet(Curve=region_difference, Radius=Slider(0.433, range=0..1))
extrude_2 = Extrude(Base=ellipse_5.Ellipse, Direction=vector_xyz_5.Vector)
extrude_3 = Extrude(Base=fillet, Direction=vector_xyz_5.Vector)
cap_holes_3 = CapHoles(Brep=extrude_3)
cap_holes_4 = CapHoles(Brep=extrude_2)
solid_difference_2 = SolidDifference(BrepsA=cap_holes_3, BrepsB=cap_holes_4)
