# Grasshopper definition flashlight_model4.gh (Grasshopper 1.0.7)

# ----
# Create handle bottom geometry
number_slider = Slider(18.3, range=0..60)
ellipse = Ellipse(Plane=PlaneXY(0, 0, 0), Radius1=number_slider, Radius2=Slider(18.2, range=0..40))  # -> Ellipse, Focus1, Focus2
vector_xyz = VectorXYZ(XComponent=0, YComponent=0, ZComponent=Slider(-142.28, range=-150..0))  # -> Vector, Length
move = Move(Geometry=ellipse.Ellipse, Motion=vector_xyz.Vector)  # -> Geometry, Transform

# ----
# Light Interior Geometry
number_slider_2 = Slider(22.15, range=0..60)
number_slider_3 = Slider(14.43, range=0..40)
ellipse_2 = Ellipse(Plane=PlaneXY(0, 0, 0), Radius1=number_slider_2, Radius2=number_slider_3)  # -> Ellipse, Focus1, Focus2

# ----
# Light top geometry
number_slider_4 = Slider(17.515, range=0..40)
number_slider_5 = Slider(25.31, range=0..60)
ellipse_3 = Ellipse(Plane=PlaneXY(0, 0, 0), Radius1=number_slider_5, Radius2=number_slider_4)  # -> Ellipse, Focus1, Focus2

# ----
# Create rectangular cutouts
# for press fitting
slot_depth = Slider(29, range=0..29)
cardboard_thickness = Slider(3.6, range=-10..10)
rectangle = Rectangle(Plane=PlaneXY(0, 0, 0), XSize=slot_depth, YSize=cardboard_thickness, Radius=0)  # -> Rectangle, Length

# ----
# Create cap for end of flashlight that
# extends beyond edges enough for
# press fit to secure
number = Number(2)
multiplication = Multiplication(A=number, B=cardboard_thickness)
addition = Addition(A=multiplication, B=number_slider_5)
addition_2 = Addition(A=multiplication, B=number_slider_4)
ellipse_4 = Ellipse(Plane=PlaneXY(0, 0, 0), Radius1=addition, Radius2=addition_2)  # -> Ellipse, Focus1, Focus2

# ----
# Create solid for cutting out from top
# of flashlight to match actual geometry
interior_depth_from_light_top = Slider(-1.59, range=-10..10)
vector_xyz_2 = VectorXYZ(XComponent=0, YComponent=0, ZComponent=interior_depth_from_light_top)  # -> Vector, Length
extrude = Extrude(Base=ellipse_2.Ellipse, Direction=vector_xyz_2.Vector)
cap_holes = CapHoles(Brep=extrude)

subtraction = Subtraction(A=number_slider_3, B=multiplication)
# Create elliptical hole so light can
# still shine out of flashlight
subtraction_2 = Subtraction(A=number_slider_2, B=multiplication)
ellipse_5 = Ellipse(Plane=PlaneXY(0, 0, 0), Radius1=subtraction_2, Radius2=subtraction)  # -> Ellipse, Focus1, Focus2

number_2 = Number(-0.5)
multiplication_2 = Multiplication(A=cardboard_thickness, B=number_2)
# Duplicate slots along top
# ellipse geometry curve
vector_xyz_3 = VectorXYZ(XComponent=slot_depth, YComponent=multiplication_2, ZComponent=0)  # -> Vector, Length
move_2 = Move(Geometry=rectangle.Rectangle, Motion=vector_xyz_3.Vector)  # -> Geometry, Transform
curve_array = CurveArray(Geometry=move_2.Geometry, Curve=ellipse_3.Ellipse, Count=Slider(12, range=0..12))  # -> Geometry, Transform

# ----
# Additional ellipse to ensure complete
# cut through for overhang
addition_3 = Addition(A=slot_depth, B=Slider(0.114, range=0..1))
ellipse_6 = Ellipse(Plane=PlaneXY(0, 0, 0), Radius1=addition_3, Radius2=Slider(21.345, range=21.203..22))  # -> Ellipse, Focus1, Focus2

# ----
# Combine curves to
# generate loft (solid
# geometry between curves)
merge = Merge(Data1=ellipse_3.Ellipse, Data2=move.Geometry)
loft = Loft(Curves=merge, Options={Adjust=False, Closed=False, LoftEnds=0, LoftSimp=0, LoftType=0, Rebuild=10, Refit=0.01})
cap_holes_2 = CapHoles(Brep=loft)

solid_difference = SolidDifference(BrepsA=cap_holes_2, BrepsB=cap_holes)

overhang_for_secure_fit = Slider(1, range=0..3.6)
vector_xyz_4 = VectorXYZ(XComponent=0, YComponent=0, ZComponent=cardboard_thickness)  # -> Vector, Length
vector_xyz_5 = VectorXYZ(XComponent=0, YComponent=0, ZComponent=overhang_for_secure_fit)  # -> Vector, Length
# Solid geometry to create a cut for overhang
# so 3D-printed part will grip flashlight
move_3 = Move(Geometry=ellipse_6.Ellipse, Motion=vector_xyz_4.Vector)  # -> Geometry, Transform
extrude_2 = Extrude(Base=move_3.Geometry, Direction=vector_xyz_5.Vector)
cap_holes_3 = CapHoles(Brep=extrude_2)

cut_slots_for_press_fit = RegionDifference(CurvesA=ellipse_4.Ellipse, CurvesB=curve_array.Geometry)
# Actual geometry of flashlight cap + hole
# to allow light to be emitted
addition_4 = Addition(A=cardboard_thickness, B=overhang_for_secure_fit)
vector_xyz_6 = VectorXYZ(XComponent=0, YComponent=0, ZComponent=addition_4)  # -> Vector, Length
extrude_for_light_emission = Extrude(Base=ellipse_5.Ellipse, Direction=vector_xyz_6.Vector)
extrude_for_overhang = Extrude(Base=cut_slots_for_press_fit, Direction=vector_xyz_6.Vector)
cap_holes_4 = CapHoles(Brep=extrude_for_light_emission)
cap_holes_5 = CapHoles(Brep=extrude_for_overhang)
solid_difference_2 = SolidDifference(BrepsA=cap_holes_5, BrepsB=cap_holes_4)

solid_difference_3 = SolidDifference(BrepsA=solid_difference_2, BrepsB=cap_holes_3)
