# Grasshopper definition triangle_connectors.gh (Grasshopper 1.0.7)

slot_width_cboard_thickness = Slider(3.6, range=2..6)
# Create Rectangular Slots for Press Fit
slot_depth = Slider(4, range=0..25.4)
rectangle = Rectangle(Plane=PlaneXY(0, 0, 0), XSize=slot_width_cboard_thickness, YSize=slot_depth, Radius=0)  # -> Rectangle, Length

# ----
# Create polygon geometry
num_sides = Number(3)
number_slider = Slider(25.4, range=0..25.4)
polygon = Polygon(Plane=PlaneXY(0, 0, 0), Radius=number_slider, Segments=num_sides, FilletRadius=0)  # -> Polygon, Length

# ----
# Set vertical vector for rectangular relative
# to midpoint of polygon side
number = Number(30)
sine = Sine(Value=degrees(number))
multiplication = Multiplication(A=number_slider, B=sine)
subtraction = Subtraction(A=multiplication, B=slot_depth)

# ----
# Center rectangular slots at
# polygon side midpoint
number_2 = Number(-0.5)
multiplication_2 = Multiplication(A=slot_width_cboard_thickness, B=number_2)

number_3 = Number(270)

# ----
# Create vector and move rectangles
vector_xyz = VectorXYZ(XComponent=multiplication_2, YComponent=subtraction, ZComponent=0)  # -> Vector, Length
move = Move(Geometry=rectangle.Rectangle, Motion=vector_xyz.Vector)  # -> Geometry, Transform

rotate = Rotate(Geometry=polygon.Polygon, Angle=degrees(number_3), Plane=PlaneXY(0, 0, 0))  # -> Geometry, Transform
polar_array = PolarArray(Geometry=move.Geometry, Plane=PlaneXY(0, 0, 0), Count=num_sides, Angle=6.283185307)  # -> Geometry, Transform
# Move completed construction kit
# to top left corner of board
pentagon_fillets = Slider(0.522, range=0..1)
# Trim slots out of polygon
region_difference = RegionDifference(CurvesA=rotate.Geometry, CurvesB=polar_array.Geometry)
fillet_distance = FilletDistance(Curve=region_difference, Distance=pentagon_fillets)

hexagon_fillets = Slider(0.771, range=0..1)
vector_xyz_2 = VectorXYZ(XComponent=Slider(-480.464, range=-508..508), YComponent=Slider(331.701, range=-508..508), ZComponent=0)  # -> Vector, Length
move_2 = Move(Geometry=fillet_distance, Motion=vector_xyz_2.Vector)  # -> Geometry, Transform

# ----
# Define rectangular cell
# for array to fill; larger =
# more gap between copies
number_slider_2 = Slider(45.5, range=0..50)
rectangle_2 = Rectangle(Plane=PlaneXY(0, 0, 0), XSize=number_slider_2, YSize=Slider(39.5, range=0..50), Radius=0)  # -> Rectangle, Length

# ----
# Create array to print
# many copies of kit
rectangular_array = RectangularArray(Geometry=move_2.Geometry, Cell=rectangle_2.Rectangle, XCount=Slider(12, range=0..20), YCount=Slider(5, range=0..20))  # -> Geometry, Transform

number_4 = Number(100)
# Reference rectangle for scaling
# 100x100mm
number_5 = Number(100)
rectangle_3 = Rectangle(Plane=PlaneXY(0, 0, 0), XSize=number_4, YSize=number_5, Radius=0)  # -> Rectangle, Length
vector_xyz_3 = VectorXYZ(XComponent=Slider(408, range=0..508), YComponent=Slider(0.25, range=0..508), ZComponent=0)  # -> Vector, Length
move_3 = Move(Geometry=rectangle_3.Rectangle, Motion=vector_xyz_3.Vector)  # -> Geometry, Transform
